# Grasshopper definition tester.ghx (Grasshopper 1.0.7)
# plug-ins: Human

trigger = Trigger(Interval=-1000, TimerInterval=1000, Target=ghpython_script)
panel = Panel("""36
26
35
28
38
40
30
37
27
32
29
31
34""")
moduleid = Slider(44, range=0..100)
series = Series(Start=0, Step=1, Count=Slider(8, range=0..10))
ghpython_script = GhPythonScript(reset=Button())  # -> count
# ---------- ghpython_script: Python ----------
import Grasshopper.Kernel as gh
import scriptcontext as sc

# Define a unique key for the counter in the Grasshopper document's sticky dictionary
counter_key = 'ghpython_counter'

# Check if the counter exists in the sticky dictionary
if counter_key not in sc.sticky or reset:
    # Increment the counter by one
    sc.sticky[counter_key] = -1
else:
    # Initialize the counter if it doesn't exist
    sc.sticky[counter_key] += 1

# Output the current value of the counter
counter = sc.sticky[counter_key]

# Set the output
count = counter
# ---------- end ghpython_script ----------
merge = Merge(Data1=flatten(series), Data2=flatten(panel))
panel_2 = Panel(ghpython_script)
sort = SortList(Keys=merge, ValuesA=merge)  # -> Keys, ValuesA
ghpython_script_2 = GhPythonScript(module=moduleid, index=Slider(12, range=0..100), write=Button())  # -> log, box, rg, text_frame, text_text, ref, lines; inputs module: Int32, index: Int32
# ---------- ghpython_script_2: Python ----------
from writehops import HOPSWriter, FrenchRidgeProcess, DoubleCutProcess, TextProcess
from parse_btlx import BTLXParser
from compas_rhino import unload_modules
import math
from compas_rhino.conversions import frame_to_rhino, point_to_rhino, line_to_rhino

from compas.geometry import Transformation, Frame, Point, Plane, Rotation, angle_vectors_signed, Vector, angle_vectors
from compas.geometry import Box, Line

import Rhino.Geometry as rg
import os

from copy import deepcopy

unload_modules("writehops")
unload_modules("parse_btlx")

# Get the path to the current Grasshopper file
current_gh_file_path = ghenv.Component.OnPingDocument().FilePath

# Ensure the current file path is valid
if current_gh_file_path:
    # Get the directory of the current Grasshopper file
    current_directory = os.path.dirname(current_gh_file_path)
    
    # Get the base directory (mas-t2-2324)
    base_directory = os.path.abspath(os.path.join(current_directory, '..', '..', 'mas-t2-2324'))
    
    # Define the new subdirectory relative path
    new_subdir = os.path.join('production', 'fabrication')
    
    # Construct the absolute path to the new directory
    new_path = os.path.join(base_directory, new_subdir)
    
    # Construct the folder and file name based on the integer index
    module_folder = "Module_{0}_test".format(module)
    module_btlx = "Module_{0}_test_frl.btlx".format(module)
    
    # Construct the full path to the BTLx file, including the 'btlx' subdirectory
    btlx_file_path = os.path.join(new_path, module_folder, 'btlx', module_btlx)
    hops_file_path = os.path.join(new_path, module_folder, 'btlx',module_folder)
    print(hops_file_path)
    # Print the constructed path
    
    # Check if the BTLx file exists
    if not os.path.isfile(btlx_file_path):
        print("The BTLx file '{0}' does not exist in the folder '{1}'.".format(module_btlx, os.path.join(new_path, module_folder, 'btlx')))
    else:
        print("The BTLx file path is correct.")
else:
    print("The Grasshopper file has not been saved yet. Please save it first.")


parser = BTLXParser(btlx_file_path)
remachining_dict = parser.get_remachining_dict()
text_dict = parser.get_text_dict()

keys = [key for key, value in remachining_dict.items()]

index = keys[index]
log = str(index) + " of %s" % str(len(keys)) + " pieces"
print(log)
#print index
#print(remachining_dict)
length = remachining_dict[str(index)]["length"]
print length
hopper = HOPSWriter(length)
processes = []
geo = []
box = Box.from_corner_corner_height([0,0,0], [length, 60,0], 60)
print remachining_dict[str(index)]
text =  text_dict[str(index)]["text"][0]
for machining in remachining_dict[str(index)]["machinings"]:
    if machining["Name"] == "French ridge lap":
        process = FrenchRidgeProcess(hopper, machining["face_front"], machining["ReferencePlaneID"])
        print process.ref_orientation
        p = "frl"
    elif machining["Name"] == "T-Butt Joint":
        p = "dc"
        process = DoubleCutProcess(hopper, machining)
    print process.ref_orientation
#    print process.
    text_process = TextProcess(process.hopper, text, process.ref_orientation)
    text_frame = frame_to_rhino(text_process.frame)
    text_text = text_process.text
    ref =frame_to_rhino(text_process.ref_frame)
    processes.append(process)
    if p == "dc":
        geo.extend([process.cf1, process.cf2])
        lines = line_to_rhino(Line(*process.pts))
    else:
        geo.extend([process.frame1, process.frame2])
hopper.generate_hops(processes)
print hopper.hop

rg = []
for f in geo:
    if isinstance(f, Frame):
        rg.append(frame_to_rhino(f))
    else:
        for frame in f:
            rg.append(frame_to_rhino(frame))
#create folder with btlx name
filename = os.path.join(hops_file_path,"%s_.hop" % str(index))
print(filename)
if write:
    hopper.write_to_file(file_path=filename)
# ---------- end ghpython_script_2 ----------
panel_3 = Panel(sort.ValuesA)
panel_4 = Panel(ghpython_script_2.log)
draw = Draw(cg=ghpython_script_2.box)  # -> rg
#   port cg: The COMPAS geometry or datastructure to be drawn.
#   port rg: The Rhino geometry object.
# ---------- draw: Python ----------
"""
Draws COMPAS geometry in Grasshopper.
"""
from ghpythonlib.componentbase import executingcomponent as component

from compas.scene import SceneObject


class CompasToRhinoGeometry(component):
    def RunScript(self, cg):
        if not cg:
            return None

        return SceneObject(cg).draw()
# ---------- end draw ----------
pln = Plane(ghpython_script_2.rg)
plane = Plane(ghpython_script_2.ref)
cluster = Cluster(brep=draw, plane=reverse(ghpython_script_2.rg))  # -> R, brep_4
cluster_2 = Cluster_2(bool=Toggle(True), brep=draw, plane=ghpython_script_2.rg)  # -> B, crv_2
text_tag_3d = TextTag3D(Location=ghpython_script_2.text_frame, Text=ghpython_script_2.text_text, Size=Slider(20, range=0..100), Justification=7)
number_slider = Slider(3.3, range=0..10)  # disabled
colour_swatch = ColourSwatch(SwatchColor=RGB(234, 255, 0))  # disabled
colour_swatch_2 = ColourSwatch(SwatchColor=RGB(0, 102, 255))  # disabled
custom_preview_lineweights = CustomPreviewLineweights(Geometry=graft(cluster.R), Shader=graft([colour_swatch, colour_swatch_2]), Thickness=number_slider, Absolute=False)  # disabled

# ==== cluster Cluster
brep = ClusterInput()
plane = ClusterInput()
plane_2 = Plane(plane)
brep_2 = Brep(brep)
debrep = DeconstructBrep(Brep=brep_2)  # -> Faces, Edges, Vertices
brep_plane = BrepPlane(Brep=brep_2, Plane=plane_2)  # -> Curves, Points
sort = SortList(Keys=debrep.Faces, ValuesA=debrep.Faces)  # -> Keys, ValuesA
dispatch = Dispatch(List=flatten(brep_plane.Curves), DispatchPattern=[True, False])  # -> ListA, ListB
item = ListItem(List=sort.ValuesA, Index=0, Wrap=True)  # -> Item, Item1
ccx = CurveCurve(CurveA=dispatch.ListA, CurveB=dispatch.ListB)  # -> Points, ParamsA, ParamsB
entwine = Entwine(Branch00=ccx.ParamsA, Branch01=ccx.ParamsB, FlattenInputs=True)
shatter = Shatter(Curve=brep_plane.Curves, Parameters=entwine)
trim = TrimTree(Tree=shatter, Depth=1)
bang = ExplodeTree(Data=trim)  # -> Branch0, Branch1
item_2 = ListItem(List=bang.Branch1, Index=0, Wrap=True)
item_3 = ListItem(List=reverse(bang.Branch0), Index=0, Wrap=True)
connect = ConnectCurves(Curves=item_3, Continuity=0, Close=True, Bulge=1)
connect_2 = ConnectCurves(Curves=item_2, Continuity=0, Close=True, Bulge=1)
merge = Merge(Data1=flatten(connect), Data2=flatten(connect_2))
boundary = BoundarySurfaces(Edges=merge)
R = ClusterOutput(merge)
join = BrepJoin(Breps=boundary)  # -> Breps, Closed
split = SplitBrep(Brep=brep_2, Cutter=join.Breps)
sort_2 = SortList(Keys=split, ValuesA=split)  # -> Keys, ValuesA
item_4 = ListItem(List=reverse(sort_2.ValuesA), Index=0, Wrap=True)
join_2 = BrepJoin(Breps=flatten([boundary, item_4]))  # -> Breps, Closed
brep_3 = Brep(join_2.Breps)
brep_4 = ClusterOutput(brep_3)

# ==== cluster Cluster_2
brep = ClusterInput()
plane = ClusterInput()
plane_2 = Plane(plane)
brep_2 = Brep(brep)
debrep = DeconstructBrep(Brep=brep_2)  # -> Faces, Edges, Vertices
sort = SortList(Keys=debrep.Faces, ValuesA=debrep.Faces)  # -> Keys, ValuesA
item = ListItem(List=sort.ValuesA, Index=0, Wrap=True)  # -> Item, Item1
offset = OffsetSurface(Surface=[item.Item, item.Item1], Distance=expr("-x", Slider(60, range=0..100)), Retrim=True)
dispatch = Dispatch(List=plane_2, DispatchPattern=[True, False])  # -> ListA, ListB
pln = Plane(offset)
entwine = Entwine(Branch00=dispatch.ListA, Branch01=pln, FlattenInputs=True)
brep_plane = BrepPlane(Brep=brep_2, Plane=entwine)  # -> Curves, Points
trim = TrimTree(Tree=brep_plane.Curves, Depth=1)
flip = FlipMatrix(Data=trim)
dispatch_2 = Dispatch(List=flip, DispatchPattern=[True, False])  # -> ListA, ListB
bool = ClusterInput()
ccx = CurveCurve(CurveA=dispatch_2.ListA, CurveB=dispatch_2.ListB)  # -> Points, ParamsA, ParamsB
shatter = Shatter(Curve=dispatch_2.ListB, Parameters=ccx.ParamsB)
bool_2 = Boolean(bool)
bang = ExplodeTree(Data=shatter)  # -> Branch0, Branch1
shatter_2 = Shatter(Curve=dispatch_2.ListA, Parameters=ccx.ParamsA)
filter = StreamFilter(Gate=bool_2, Stream0=reverse(bang.Branch0), Stream1=bang.Branch0)
filter_2 = StreamFilter(Gate=bool_2, Stream0=reverse(bang.Branch1), Stream1=bang.Branch1)
bang_2 = ExplodeTree(Data=shatter_2)  # -> Branch0, Branch1
item_2 = ListItem(List=reverse(bang_2.Branch0), Index=0, Wrap=True)
item_3 = ListItem(List=reverse(filter_2), Index=0, Wrap=True)
item_4 = ListItem(List=bang_2.Branch1, Index=0, Wrap=True)
item_5 = ListItem(List=filter, Index=0, Wrap=True)
connect = ConnectCurves(Curves=graft([item_4, item_3]), Continuity=0, Close=True, Bulge=1)
connect_2 = ConnectCurves(Curves=graft([item_2, item_5]), Continuity=0, Close=True, Bulge=1)
crv = Curve(flatten([connect, connect_2]))
crv_2 = ClusterOutput(crv)
boundary = BoundarySurfaces(Edges=flatten(connect))
boundary_2 = BoundarySurfaces(Edges=flatten(connect_2))
join = BrepJoin(Breps=boundary)  # -> Breps, Closed
join_2 = BrepJoin(Breps=boundary_2)  # -> Breps, Closed
merge = Merge(Data1=join_2.Breps, Data2=join.Breps)
splitmul = SplitBrepMultiple(Brep=brep_2, Cutters=merge)
sort_2 = SortList(Keys=splitmul, ValuesA=splitmul)  # -> Keys, ValuesA
item_6 = ListItem(List=reverse(sort_2.ValuesA), Index=0, Wrap=True)
join_3 = BrepJoin(Breps=flatten([item_6, join_2.Breps, join.Breps]))  # -> Breps, Closed
B = ClusterOutput(join_3.Breps)
